# Grasshopper definition windrose_plot.gh (Grasshopper 1.0.7)

download_weather = Panel("https://www.energyplus.net/weather-download/asia_wmo_region_2/CHN//CHN_Beijing.Beijing.545110_SWERA/all")
downloadepw = LBDownloadWeather(weather_URL=download_weather)  # -> epw_file, stat_file, ddy_file; plug-in component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
importepw = LBImportEPW(epw_file=downloadepw.epw_file)  # -> location, dry_bulb_temperature, dew_point_temperature, relative_humidity, wind_speed, wind_direction, direct_normal_rad, diffuse_horizontal_rad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; plug-in component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
windrose = LBWindRose(
    data=[importepw.wind_speed, importepw.dry_bulb_temperature],
    wind_direction=importepw.wind_direction,
    statement="9 < b < 26")  # -> report, mesh, compass, orient_line, freq_line, legend, title, prevailing, histogram, data; plug-in component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
